# Grasshopper definition AIJ_CaseE_ac_N_validation.gh (Grasshopper 1.0.7)

# ---- group: 1 Load Official Data
# Experiment summary: AIJ Case E (Niigata) validation: case=ac, wind=N
# CityLBM baseline: v0.2.0 portable
# STL scaled 250x; height max 60 m; measurement points: 80
# Load report: Load report from GhPython appears here.
# 1-2 Official data: 1 Load Official Data
# BD_caseE.stl, AF_caseE.csv, RS_caseE.csv
# 2 Scale Geometry
# Model scale 1:250 -> actual scale
rs_casee_ac_n_points = RS_caseEAcNPoints([Point(-27, 112, 2), Point(-93, 33, 2), Point(-88, 35, 2), Point(-74, 40, 2), Point(-61, 45.5, 2), Point(-50.5, 49.5, 2)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])

# ---- group: 3 Create Scene + Set Inflow
n_wind_vector = NWindVector(Vector(0, -1, 0))
domain_ext = DomainExt(0.8)
uref_15_9m = Uref159m(3.928296)
powerlaw = PowerLaw(1)
rough_c = RoughC(2)
name = Name("AIJCASEE_ac_N")
zr = Zr(15.9)
z0 = Z0(0.3)
# 6 Postprocess: 6 Postprocess to Excel
# Run after CityLBM writes VTK:
# python postprocess\AIJ_CaseE_ac_N_PostProcess.py --case-dir <CaseDir>
# Output: outputs\case_ac_N\AIJCASEE_ac_N_validation.xlsx
scene = CreateScene(
    Name=name,
    WindSpeed=uref_15_9m,
    WindDirection=n_wind_vector,
    WindProfile=powerlaw,
    ReferenceHeight=zr,
    RoughnessCategory=rough_c,
    RoughnessLength=z0,
    DomainExtension=domain_ext)  # -> Scene, ProfileInfo

# ---- group: 1 Load Official Data / 2 Scale Geometry (250x)
python = GhPythonScript()  # -> Mesh, Report, Points
# ---------- python: Python ----------
# AIJ Case E ac + N: load official data and scaled STL for CityLBM.
# GhPython outputs:
#   a: scaled building mesh (actual scale, m)
#   b: setup report text
#   c: measurement points at z=2m

import csv
import os
import Rhino.Geometry as rg

ROOT = u"F:\\Grade2master2\\CITYLBM\u5f00\u53d1\u6587\u4ef6\\citylbm_v0.2.0_portable\\validation\\\u3010\u9a8c\u8bc1\u3011AIJCASEE"
OFFICIAL = os.path.join(ROOT, "official_data")
STL_PATH = os.path.join(OFFICIAL, "BD_caseE.stl")
AF_PATH = os.path.join(OFFICIAL, "AF_caseE.csv")
RS_PATH = os.path.join(OFFICIAL, "RS_caseE.csv")

SCALE = 250.0
CASE_NAME = "ac"
WIND_DIRECTION = "N"
WIND_VECTOR = rg.Vector3d(0.0, -1.0, 0.0)
REFERENCE_HEIGHT = 15.9


def read_csv(path):
    with open(path, "r") as f:
        return list(csv.DictReader(f))


def interpolate_u_ref(rows, z):
    pts = sorted((float(r["z(m)"]), float(r["U(m/s)"])) for r in rows)
    if z <= pts[0][0]:
        return pts[0][1]
    if z >= pts[-1][0]:
        return pts[-1][1]
    for p0, p1 in zip(pts, pts[1:]):
        if p0[0] <= z <= p1[0]:
            t = (z - p0[0]) / (p1[0] - p0[0])
            return p0[1] + t * (p1[1] - p0[1])
    return pts[-1][1]


def read_ascii_stl_scaled(path, scale):
    mesh = rg.Mesh()
    tri = []
    with open(path, "r") as f:
        for line in f:
            p = line.strip().split()
            if len(p) == 4 and p[0].lower() == "vertex":
                pt = rg.Point3d(float(p[1]) * scale, float(p[2]) * scale, float(p[3]) * scale)
                tri.append(pt)
                if len(tri) == 3:
                    i = mesh.Vertices.Count
                    mesh.Vertices.Add(tri[0])
                    mesh.Vertices.Add(tri[1])
                    mesh.Vertices.Add(tri[2])
                    mesh.Faces.AddFace(i, i + 1, i + 2)
                    tri = []
    mesh.Normals.ComputeNormals()
    mesh.Compact()
    return mesh


af_rows = read_csv(AF_PATH)
rs_rows = read_csv(RS_PATH)
u_ref = interpolate_u_ref(af_rows, REFERENCE_HEIGHT)
case_rows = [
    r for r in rs_rows
    if r["case"].strip().lower() == CASE_NAME and r["Wind_direction"].strip().upper() == WIND_DIRECTION
]

building = read_ascii_stl_scaled(STL_PATH, SCALE)
bbox = building.GetBoundingBox(True)
points = [rg.Point3d(float(r["x(m)"]), float(r["y(m)"]), float(r["z(m)"])) for r in case_rows]

report = []
report.append("AIJ Case E (Niigata) validation setup")
report.append("case = ac, wind direction = N")
report.append("CityLBM baseline = v0.2.0 portable")
report.append("STL scale = 250.0, actual height max = %.3f m" % bbox.Max.Z)
report.append("Bounds X[%.3f, %.3f] Y[%.3f, %.3f] Z[%.3f, %.3f] m" % (
    bbox.Min.X, bbox.Max.X, bbox.Min.Y, bbox.Max.Y, bbox.Min.Z, bbox.Max.Z))
report.append("Measurement points = %d at z=2 m" % len(points))
report.append("Wind vector = (0, -1, 0), from north to south")
report.append("Uref = %.3f m/s at z=15.9 m from AF_caseE.csv" % u_ref)
report.append("Initial grid dx = 5 m; production dx = 2-3 m")
report.append("Run Simulation is intentionally controlled by a Boolean panel.")

a = building
b = "\n".join(report)
c = points
# ---------- end python ----------

# ----
addbld = AddBuildings(Scene=scene.Scene, Buildings=python.Mesh)

# ---- group: 4 Generate Grid
dx_preview = DxPreview(5)
auto_off = AutoOff(False)
grid = GenerateGrid(Scene=addbld, CellSize=dx_preview, AutoOptimize=auto_off)  # -> Grid, Info

# ---- group: 5 Run Simulation
save_interval = SaveInterval(500)
ws_override = WSOverride(3.928296)
fx3d_blank = FX3DBlank("")
run_switch = RunSwitch(False)
mode_3 = Mode3(3)
nu = Nu(1.5e-05)
steps = Steps(2000)
les = LES(True)
cs = Cs(0.12)
cancel = Cancel(False)
sim = RunSimulation(
    Scene=addbld,
    Grid=grid.Grid,
    FluidX3DPath=fx3d_blank,
    Mode=mode_3,
    WindSpeed=ws_override,
    Viscosity=nu,
    TimeSteps=steps,
    SaveInterval=save_interval,
    EnableLES=les,
    Cs=cs,
    Run=run_switch,
    Cancel=cancel)  # -> CaseDir, OutputDir, Success, Status, Progress, Log
