# Grasshopper definition AIJ_CaseA_validation.gh (Grasshopper 1.0.5)
# plug-ins: Bifocals, CityLBM

construct_point = ConstructPoint(XCoordinate=0, YCoordinate=0, ZCoordinate=Slider(40, range=0..100))
create_scene = CreateScene(
    Name="验证实验AIJcaseA2121",
    WindSpeed=5,
    WindDirection=Vector(1, 0, 0),
    WindProfile=1,
    ReferenceHeight=10,
    RoughnessCategory=2,
    RoughnessLength=0.3,
    DomainExtension=0.2)  # -> Scene, ProfileInfo
center_box = CenterBox(Base=construct_point, X=Slider(20, range=0..100), Y=Slider(20, range=0..100), Z=Slider(40, range=0..100))
add_buildings = AddBuildings(Scene=create_scene.Scene, Buildings=center_box)
scene_info = SceneInfo(Scene=add_buildings)  # -> Name, BuildingCount, TotalVertices, TotalFaces, WindSpeed, WindDirection, DomainBounds, Validation
read_vtk = ReadVTK(TimeStep=-2, SubsampleSpacing=5, SubsampleStep=-1)  # -> Points, Velocity, Pressure, TimeStep, Info, GridSpacing, Log
read_vtk_2 = ReadVTK(TimeStep=-2, SubsampleSpacing=5, SubsampleStep=-1)  # -> Points, Velocity, Pressure, TimeStep, Info, GridSpacing, Log
vtk_cloud_map = VTKCloudMap(
    TimeStep=-2,
    SubsampleSpacing=5,
    Mode=0,
    SliceZ=nan,
    SliceCount=5,
    GridSize=0,
    ContourCount=10,
    ColorLow=RGB(0, 0, 255),
    ColorHigh=RGB(255, 0, 0),
    UseGradient=True)  # -> Mesh, Contours, MinValue, MaxValue, Legend, Info, Log
panel = Panel(scene_info.Name)
visualize_velocity = VisualizeVelocity(
    Points=read_vtk_2.Points,
    Velocity=read_vtk_2.Velocity,
    Scale=1,
    Skip=3,
    SliceZ=nan,
    ZTolerance=0,
    ArrowStyle=1,
    ColorLow=RGB(0, 0, 255),
    ColorHigh=RGB(255, 0, 0))  # -> Arrows, Colors, Magnitude, ArrowPoints, Log
domain_designer = DomainDesigner(
    Scene=add_buildings,
    XMinus=Slider(200, range=0..1000),
    XPlus=Slider(600, range=0..1000),
    YMinus=Slider(200, range=0..1000),
    YPlus=Slider(200, range=0..1000),
    Height=Slider(240, range=0..1000),
    AutoScale=0)  # -> Scene, BasePoint, DomainBox, DomainInfo
read_vtk_3 = ReadVTK(Scene=domain_designer.Scene, TimeStep=-2, SubsampleSpacing=5, SubsampleStep=-1)  # -> Points, Velocity, Pressure, TimeStep, Info, GridSpacing, Log
simulation_stats = SimulationStats(Points=read_vtk_3.Points, Velocity=read_vtk_3.Velocity, GridSpacing=0)  # -> Report, MaxWindSpeed, MeanWindSpeed, MinWindSpeed, StdWindSpeed, MaxVertical, MinVertical, MedianWindSpeed, WindSpeedClasses
panel_2 = Panel(simulation_stats.Report)
scene_info_2 = SceneInfo(Scene=domain_designer.Scene)  # -> Name, BuildingCount, TotalVertices, TotalFaces, WindSpeed, WindDirection, DomainBounds, Validation
velocity_slice = VelocitySlice(
    Points=read_vtk_3.Points,
    Velocity=read_vtk_3.Velocity,
    Tolerance=Slider(5, range=0..10),
    GridSize=0,
    ColorLow=RGB(0, 0, 255),
    ColorHigh=RGB(255, 0, 0))  # -> SlicePoints, SliceVelocity, VelocityMagnitude, SliceMesh, MinValue, MaxValue, Info
velocity_slice_2 = VelocitySlice(
    Points=read_vtk_3.Points,
    Velocity=read_vtk_3.Velocity,
    Height=Slider(0, range=0..100),
    Tolerance=Slider(5, range=0..10),
    GridSize=0,
    ColorLow=RGB(0, 0, 255),
    ColorHigh=RGB(255, 0, 0))  # -> SlicePoints, SliceVelocity, VelocityMagnitude, SliceMesh, MinValue, MaxValue, Info
wind_streamlines = WindStreamlines(
    Points=read_vtk_3.Points,
    Velocity=read_vtk_3.Velocity,
    SeedCount=Slider(50, range=0..100),
    StepSize=2,
    MaxSteps=1000,
    MinSpeed=0.05,
    LineWidth=2,
    Show=True,
    UseAdaptive=True,
    SeedMode=0)  # -> Streamlines, Speeds, Info
wind_condition = WindCondition(WindDirection=0, WindSpeed=5, CompassRadius=20, ShowProfile=True)  # -> Info, WindVector
panel_3 = Panel(domain_designer.DomainInfo)
panel_4 = Panel(scene_info_2.Validation)
panel_5 = Panel(domain_designer.BasePoint)
panel_6 = Panel(read_vtk_3.Log)
panel_7 = Panel(read_vtk_2.Info)
mesh = Mesh(velocity_slice_2.SliceMesh)
generate_grid = GenerateGrid(Scene=domain_designer.Scene, CellSize=1, AutoOptimize=True)  # -> Grid, Info
run_simulation = RunSimulation(
    Scene=domain_designer.Scene,
    Grid=generate_grid.Grid,
    Mode=3,
    WindSpeed=0,
    Viscosity=1.5e-05,
    TimeSteps=2000,
    SaveInterval=1000,
    Run=Toggle(True),
    Cancel=False)  # -> CaseDir, OutputDir, Success, Status, Progress, Log
panel_8 = Panel(run_simulation.Log)
panel_9 = Panel(run_simulation.Progress)
