# Grasshopper definition AIJ_CaseE_ac_N_citylbm_full_workflow.gh (Grasshopper 1.0.7)
# plug-ins: CityLBM

bd_casee_mesh = BD_caseEScaledX250Mesh([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])
# Validation Notes: AIJ Case E validation / ac + N / CityLBM v0.1.0WIP
# Geometry: import BD_caseE.stl in Rhino, scale x250, then set the mesh below.
# Wind: (0,-1,0), Uref=3.928296 m/s @ z=15.9 m, profile=PowerLaw RC=C alpha=0.22.
# Domain: X[-300,300], Y[-500,300], Z[0,240], dx=5 m, steps=2000, save=1000.
# Set Run=True only after the mesh is connected and FluidX3D path exists.
create_scene = CreateScene(
    Name="AIJCASEE_ac_N_v010_dx5_2000",
    WindSpeed=3.928296,
    WindDirection=Vector(0, -1, 0),
    WindProfile=1,
    ReferenceHeight=15.9,
    RoughnessCategory=2,
    RoughnessLength=0.3,
    DomainExtension=0)  # -> Scene, ProfileInfo
add_buildings = AddBuildings(Scene=create_scene.Scene, Buildings=bd_casee_mesh)
domain = DomainDesigner(Scene=add_buildings, XMinus=300, XPlus=300, YMinus=500, YPlus=300, Height=240, AutoScale=0)  # -> Scene, BasePoint, DomainBox, DomainInfo
# Workflow Notes: Full CityLBM verification workflow for AIJ Case E ac+N
# Left: CityLBM scene/building/domain/grid/run chain.
# Right: CityLBM result pipeline from real VTK output.
# Main thesis visualization: Read VTK -> Velocity Slice -> Wind Speed Grid / VTK Cloud Map.
# Do not use Visualize Velocity arrow output for final proof screenshots.
# Accuracy Boundary: Probe/comfort are diagnostic checks. For AIJ validation, compare sampled velocities with RS_caseE.csv separately.
# This GH file proves component-chain availability and VTK-driven visualization, not final benchmark accuracy.
scene_info = SceneInfo(Scene=domain.Scene)  # -> Name, BuildingCount, TotalVertices, TotalFaces, WindSpeed, WindDirection, DomainBounds, Validation
read_latest_citylbm_vtk = ReadVTK(
    Scene=domain.Scene,
    VTKPath="F:\Grade2master2\CITYLBM开发文件\citylbm_v0.2.0_portable\validation\parallel_experiments\experiment_2_casee\citylbm\FluidX3D_CityLBM_v010_CaseE\output",
    TimeStep=-2,
    SubsampleSpacing=20,
    SubsampleStep=-1)  # -> Points, Velocity, Pressure, TimeStep, Info, GridSpacing, Log
z_5m_slice = VelocitySlice(
    Points=read_latest_citylbm_vtk.Points,
    Velocity=read_latest_citylbm_vtk.Velocity,
    Height=5,
    Tolerance=2.6,
    GridSize=20,
    ColorLow=RGB(0, 0, 255),
    ColorHigh=RGB(255, 0, 0))  # -> SlicePoints, SliceVelocity, VelocityMagnitude, SliceMesh, MinValue, MaxValue, Info
scalar_grid = WindSpeedGrid(
    Points=z_5m_slice.SlicePoints,
    Velocity=z_5m_slice.SliceVelocity,
    CellSize=20,
    ColorLow=RGBA(0, 0, 255, 180),
    ColorHigh=RGBA(255, 0, 0, 180),
    Decimals=2,
    ShowGrid=True)  # -> GridMesh, CellLabels, LabelPoints, MinSpeed, MaxSpeed, Info
cloud_z_5m = VTKCloudMap(
    Scene=domain.Scene,
    VTKPath="F:\Grade2master2\CITYLBM开发文件\citylbm_v0.2.0_portable\validation\parallel_experiments\experiment_2_casee\citylbm\FluidX3D_CityLBM_v010_CaseE\output",
    TimeStep=-2,
    SubsampleSpacing=20,
    Mode=0,
    SliceZ=5,
    SliceCount=5,
    GridSize=20,
    ContourCount=10,
    ColorLow=RGB(0, 0, 255),
    ColorHigh=RGB(255, 0, 0),
    UseGradient=True)  # -> Mesh, Contours, MinValue, MaxValue, Legend, Info, Log
stats = SimulationStats(
    Points=read_latest_citylbm_vtk.Points,
    Velocity=read_latest_citylbm_vtk.Velocity,
    GridSpacing=read_latest_citylbm_vtk.GridSpacing,
    SceneInfo=scene_info.Validation)  # -> Report, MaxWindSpeed, MeanWindSpeed, MinWindSpeed, StdWindSpeed, MaxVertical, MinVertical, MedianWindSpeed, WindSpeedClasses
probe_optional = DataProbe(
    Points=read_latest_citylbm_vtk.Points,
    Velocity=read_latest_citylbm_vtk.Velocity,
    SearchRadius=0,
    ShowVectors=False,
    EnablePreview=False)  # -> ProbeInfo, Speed, Velocity, Pressure, ProbePosition
grid = GenerateGrid(Scene=domain.Scene, CellSize=5, AutoOptimize=False)  # -> Grid, Info
run_simulation = RunSimulation(
    Scene=domain.Scene,
    Grid=grid.Grid,
    FluidX3DPath="F:\Grade2master2\CITYLBM开发文件\citylbm_v0.2.0_portable\validation\parallel_experiments\experiment_2_casee\citylbm\FluidX3D_CityLBM_v010_CaseE",
    Mode=3,
    WindSpeed=0,
    Viscosity=1.5e-05,
    TimeSteps=2000,
    SaveInterval=1000,
    Run=False,
    Cancel=False)  # -> CaseDir, OutputDir, Success, Status, Progress, Log
